# Grasshopper definition fine_hair.gh (Grasshopper 1.0.7)

python = GhPythonScript()  # -> out, file
# ---------- python: Python ----------
import rhinoscriptsyntax as rs

filter = "GCode (*.gcode)|*.gcode|All Files (*.*)|*.*||"
file = rs.SaveFileName("", filter)
# ---------- end python ----------
python_2 = GhPythonScript(file=python.file)  # -> out, lines, extrusion, turtle
# ---------- python_2: Python ----------
# code required so that library reloads appropriately
# must be above other import statements
import sys
to_delete = list()
for module in sys.modules:
   if "extruder_turtle" in module:
      to_delete.append(module)  

for module in to_delete:
    sys.modules.pop(module)
    
import rhinoscriptsyntax as rs
import numbers
import extruder_turtle
from extruder_turtle import *
import math

reload(extruder_turtle)

t = ExtruderTurtle()
t.track_history = True
t.use_degrees = True

## Set up the turtle
t.name(file)
startingX = 20
startingY = 60
startingZ = 0
t.setup(x=startingX, y=startingY, z=startingZ)

def brush_support(size, layers):
    t.rate(1000)
    t.set_density(.07)
    t.penup()
    t.backward(size/2)
    t.pendown()
    for i in range(int(layers/2)):
            t.forward(size)
            t.lift(.2)
            t.forward(-size)
            t.lift(.2)
    t.penup()
    t.forward(size/2)
    t.pendown()

hair_length = 100
brush_width = 30
hair_spacing = 1
layers = 1
offset = 3
    
t.left(90)
brush_support(brush_width,10)
t.penup()
t.set_position(startingX+hair_length, startingY, t.getZ()+10)
t.lift(-t.getZ())
brush_support(brush_width,10)
t.penup()
t.backward(brush_width/2)
startingXfar = t.getX()
startingYfar = t.getY()
startingZfar = t.getZ()

for j in range(layers):
    t.forward(offset)
    t.forward((hair_spacing/layers)*j)
    #t.pendown() # use only for visualization
    for i in range(int((brush_width-offset*2)/hair_spacing)):
        t.left(90)
        t.rate(2000)
        t.extrude(5)
        t.forward(hair_length)
        t.extrude(-2)
        t.lift(2)
        t.right(90)
        t.backward(1)
        t.lift(-2)
        t.forward(hair_spacing+1)
        t.right(90)
        t.forward(hair_length)
        t.left(90)
    topZ = t.getZ()
    t.lift(10)
    t.set_position(startingX, startingY, topZ+10)
    t.lift(-10)
    brush_support(brush_width,4)
    t.penup()
    t.lift(10)
    t.set_position(startingX+hair_length, startingY, topZ+10)
    t.lift(-10)
    brush_support(brush_width,4)
    t.penup()
    t.backward(brush_width/2)
    t.lift(.2)


#####################################################


lines = []
for l in t.line_segs:
    lines.append(rs.AddLine(l[0], l[1]))

extrusion = []
i = 0
for e in t.extrusion_history:
    if (i>0):
        distance = rs.CurveLength(lines[i])
        density = e/distance
        extrusion.append(density*3)
    i=i+1

t.finish()
# ---------- end python_2 ----------
line = Line(python_2.lines)
srf = Surface(python_2.turtle)
pipe = Pipe(Curve=line, Radius=python_2.extrusion, Caps=0)
