# Grasshopper definition hair_bracelet.gh (Grasshopper 1.0.7)

python = GhPythonScript()  # -> out, file
# ---------- python: Python ----------
import rhinoscriptsyntax as rs

filter = "GCode (*.gcode)|*.gcode|All Files (*.*)|*.*||"
file = rs.SaveFileName("", filter)
# ---------- end python ----------
python_2 = GhPythonScript(file=python.file)  # -> out, lines, extrusion
# ---------- python_2: Python ----------
# code required so that library reloads appropriately
# must be above other import statements
import sys
to_delete = list()
for module in sys.modules:
   if "extruder_turtle" in module:
      to_delete.append(module)  

for module in to_delete:
    sys.modules.pop(module)
    
import rhinoscriptsyntax as rs
import numbers
import extruder_turtle
from extruder_turtle import *
import math

reload(extruder_turtle)

t = ExtruderTurtle()
t.track_history = True
t.use_degrees = True

## Set up the turtle
t.name(file)
t.setup(x=70, y=70, z=0)
t.rate(1000)

hairs = 30
hair_spacing = .6
hair_length = 40
solid_spacing = .5

def draw_turtle(t, hypotenuse = 2):
    angle = 40
    t.left(90)
    t.forward(math.cos(math.radians(90-angle/2))*hypotenuse)
    t.right(90+angle/2)
    t.forward(hypotenuse)
    t.right(180-angle)
    t.forward(hypotenuse)
    t.right(90+angle/2)
    t.forward(math.cos(math.radians(90-angle/2))*hypotenuse)
    t.right(90)


def circle(diameter, facets=360):
    circumference = math.pi*diameter
    step = circumference/facets
    t.penup()
    t.forward(diameter/2)
    t.pendown()
    t.right(90)
    for i in range(facets):
        t.forward(step)
        t.right(360/facets)
    t.penup()
    t.left(90)
    t.forward(-diameter/2)
    t.pendown()
    
def hairy_circle(diameter, facets=360):
    t.set_density(.04)
    inner_diameter = diameter
    outer_diameter = diameter+20
    inner_C = math.pi*inner_diameter
    outer_C = math.pi*outer_diameter
    inner_step = inner_C/facets
    outer_step = outer_C/facets

    circle(inner_diameter, facets=facets)    
    t.set_density(.02)
    circle(outer_diameter, facets=facets)
    
    t.lift(.2)
    t.penup()
    t.forward(inner_diameter/2)
    t.right(90.0)
    t.pendown()
    
    t.set_density(.01)
    for i in range(facets):
        t.forward(inner_step)
        
        #hair
        t.left(90.0)
        t.forward(11.0)
        t.backward(11.0)
        t.right(90.0)
        
        t.right(360/facets)
        
    t.penup()
    t.left(90)
    t.forward(-diameter/2)
    t.pendown()


inner_diameter = 60
outer_diameter = inner_diameter+20
facets=70

for i in range(5):
    t.set_density(.04)
    circle(inner_diameter, facets=facets)    
    t.set_density(.02)
    circle(outer_diameter, facets=facets)
    t.lift(.2)
    
for i in range (40):
    hairy_circle(inner_diameter, facets=facets)
    t.right(360/facets/5)

#draw_turtle(t)
#draw_turtle(t)

#####################################################


#draw_turtle(t)

lines = []
for l in t.line_segs:
    lines.append(rs.AddLine(l[0], l[1]))

extrusion = []
i = 0
for e in t.extrusion_history:
    if (i>0):
        distance = rs.CurveLength(lines[i])
        density = e/distance
        extrusion.append(density*3)
    i=i+1

t.finish()
# ---------- end python_2 ----------
line = Line(python_2.lines)
pipe = Pipe(Curve=line, Radius=python_2.extrusion, Caps=0)
