# Grasshopper definition simple.gh (Grasshopper 1.0.7)

python = GhPythonScript()  # -> out, file
# ---------- python: Python ----------
import rhinoscriptsyntax as rs

filter = "GCode (*.gcode)|*.gcode|All Files (*.*)|*.*||"
file = rs.SaveFileName("", filter)
# ---------- end python ----------
python_2 = GhPythonScript(file=python.file, density=Slider(3.4, range=0..5))  # -> out, lines, extrusion, point
# ---------- python_2: Python ----------
# code required so that library reloads appropriately
# must be above other import statements
import sys
to_delete = list()
for module in sys.modules:
   if "extruder_turtle" in module:
      to_delete.append(module)  

for module in to_delete:
    sys.modules.pop(module)
    
import rhinoscriptsyntax as rs
import numbers
import extruder_turtle
from extruder_turtle import *
import math

reload(extruder_turtle)


## Set up the turtle
t = ExtruderTurtle()
t.track_history = True
t.use_degrees = True
t.name(file)
t.setup(x=0, y=20, z=1.5)
t.set_density(density)

for layer in range (10):
    for i in range(360):
        t.forward(.5)
        t.right(1)
    t.lift(1.5)
    

#######################################
#######################################
#######################################
#######################################
lines = []
for l in t.line_segs:
    lines.append(rs.AddLine(l[0], l[1]))

extrusion = []
i = 0
for e in t.extrusion_history:
    if (i>0):
        distance = rs.CurveLength(lines[i])
        density = e/distance
        if (density == 0):
            density = (t.extrusion_history[i-1])/rs.CurveLength(lines[i-1])
        extrusion.append(density/3)
    i=i+1

t.finish()
# ---------- end python_2 ----------
line = Line(python_2.lines)
pipe = Pipe(Curve=line, Radius=python_2.extrusion, Caps=0)
pt = Point(python_2.point)
sph = Sphere(Base=pt, Radius=Slider(2.9, range=0..20))
