# Grasshopper definition simple_example.gh (Grasshopper 1.0.7)

python = GhPythonScript()  # -> out, file
# ---------- python: Python ----------
import rhinoscriptsyntax as rs

filter = "GCode (*.gcode)|*.gcode|All Files (*.*)|*.*||"
file = rs.SaveFileName("", filter)
# ---------- end python ----------
python_2 = GhPythonScript(file=python.file)  # -> out, lines, extrusion, turtle
# ---------- python_2: Python ----------
# code required so that library reloads appropriately
# must be above other import statements
import sys
to_delete = list()
for module in sys.modules:
   if "extruder_turtle" in module:
      to_delete.append(module)  

for module in to_delete:
    sys.modules.pop(module)
    
import rhinoscriptsyntax as rs
import numbers
import extruder_turtle
from extruder_turtle import *
import math

reload(extruder_turtle)

t = ExtruderTurtle()
t.track_history = True
t.use_degrees = True

## Set up the turtle
t.name(file)
t.setup(x=100, y=50, z=0)
t.rate(1000)
t.extruder_temp(194)
t.bed_temp(55)

hairs = 50
hair_spacing = .59
hair_length = 45
solid_spacing = .45
thickness = 15
embed_hair = 4
#print ("Brush size: ", hairs*hair_spacing)

def draw_turtle(t, hypotenuse = 2):
    angle = 40
    t.left(90)
    t.forward(math.cos(math.radians(90-angle/2))*hypotenuse)
    t.right(90+angle/2)
    t.forward(hypotenuse)
    t.right(180-angle)
    t.forward(hypotenuse)
    t.right(90+angle/2)
    t.forward(math.cos(math.radians(90-angle/2))*hypotenuse)
    t.right(90)

def brush_support(layers):
    t.rate(1000)
    for i in range(layers):
        for j in range(2):
            t.forward(hair_spacing*hairs*2)
            t.left(90)
            t.penup()
            t.forward(hair_length)
            t.left(90)
            t.pendown()
        t.lift(.2)
        
def brush_support2(layers, thickness):
    t.rate(900)
    t.set_density(.04)
    for i in range(layers):
            t.pendown()
            # solid block
            for k in range(thickness):
                t.forward(hair_spacing*hairs*2)
                t.left(90)
                t.forward(solid_spacing)
                t.left(90)
                t.forward(hair_spacing*hairs*2)
                t.right(90)
                t.forward(solid_spacing)
                t.right(90)
            #add square around zig zags for strength
            for k in range(2):
                t.forward(hair_spacing*hairs*2)
                t.right(90)
                t.forward(solid_spacing*thickness*2)
                t.right(90)
            # hair support
            t.penup()
            t.forward(hair_spacing*hairs*2) #move across width of brush
            t.left(90)
            t.forward(hair_length-embed_hair)          #move across length of brush
            t.left(90)
            t.pendown()
            t.forward(hair_spacing*hairs*2) # far side line
            t.left(90)
            t.penup() 
            t.forward(hair_length-embed_hair)          # come back to near side
            t.left(90)
            #prepare for next layer
            t.lift(.2)
            #go back to starting position
            t.left(90)
            t.backward(solid_spacing*thickness*2)
            t.right(90)
    #go to edge of support structure
    t.left(90)
    t.forward(solid_spacing*thickness*2)
    t.right(90)
    t.pendown()

def hair_layer(offset=4):
    offset2 = 4
    t.rate(800)
    t.set_density(.015)
    if (offset != 0):
        t.forward(offset)
    for i in range(hairs+1-offset2*2):
        t.forward(hair_spacing)
        t.dwell(100)
        t.left(90)
        t.forward(hair_length)
        t.right(90)
        t.forward(hair_spacing)
        t.dwell(100)
        t.right(90)
        t.forward(hair_length)
        t.left(90)
    t.backward(hair_spacing*(hairs+1-offset2*2)*2)
    if (offset != 0):
        t.forward(-offset)


t.lift(.2)
# three layers of support before brushes
brush_support2(3,thickness)

#10 layers of brushes
for i in range(15):
    t.penup()
    t.left(90)
    t.backward(embed_hair)
    t.right(90)
    offset = 4+(i%2)*(hair_spacing/2)
    t.extrude(-2)
    t.pendown()
    hair_layer(offset)
    t.penup()
    t.left(90)
    t.forward(embed_hair)
    t.backward(solid_spacing*thickness*2)
    t.right(90)
    t.pendown()
    brush_support2(1,thickness)
t.left(90)
t.backward(solid_spacing*thickness*2)
t.right(90)

# three layers of support after brushes
brush_support2(3,thickness)

turtle = t.draw_turtle()


#####################################################


lines = []
for l in t.line_segs:
    lines.append(rs.AddLine(l[0], l[1]))

extrusion = []
i = 0
for e in t.extrusion_history:
    if (i>0):
        distance = rs.CurveLength(lines[i])
        density = e/distance
        extrusion.append(density*3)
    i=i+1

t.finish()
# ---------- end python_2 ----------
line = Line(python_2.lines)
srf = Surface(python_2.turtle)
pipe = Pipe(Curve=line, Radius=python_2.extrusion, Caps=0)
