# Grasshopper definition simple_hair.gh (Grasshopper 1.0.7)

python = GhPythonScript()  # -> out, file
# ---------- python: Python ----------
import rhinoscriptsyntax as rs

filter = "GCode (*.gcode)|*.gcode|All Files (*.*)|*.*||"
file = rs.SaveFileName("", filter)
# ---------- end python ----------
python_2 = GhPythonScript(file=python.file)  # -> out, lines, extrusion, turtle
# ---------- python_2: Python ----------
# code required so that library reloads appropriately
# must be above other import statements
import sys
to_delete = list()
for module in sys.modules:
   if "extruder_turtle" in module:
      to_delete.append(module)  

for module in to_delete:
    sys.modules.pop(module)
    
import rhinoscriptsyntax as rs
import numbers
import extruder_turtle
from extruder_turtle import *
import math

reload(extruder_turtle)

t = ExtruderTurtle()
t.track_history = True
t.use_degrees = True

## Set up the turtle
t.name(file)
t.setup(x=120, y=120, z=0)

hairs = 20
hair_spacing = 1
hair_length = 45

def brush_support(layers):
    t.rate(1000)
    t.set_density(.06)
    for i in range(layers):
        for j in range(2):
            if (t.pen != True):
                t.pendown()
            t.forward(hair_spacing*hairs*2)
            t.left(90)
            t.penup()
            t.forward(hair_length)
            t.left(90)
        t.lift(.2)
    t.pendown()
        
def hair_layer(offset=0):
    t.rate(800)
    t.set_density(.015)
    if (offset!=0):
        t.forward(offset)
    for i in range(hairs):
        t.forward(hair_spacing)
        t.left(90)
        t.forward(hair_length)
        t.right(90)
        t.forward(hair_spacing)
        t.right(90)
        t.forward(hair_length)
        t.left(90)
    t.backward(hair_spacing*hairs*2)
    if (offset!=0):
        t.backward(offset)
    
    

# three layers of support before brushes
brush_support(10)
t.extrude(-1)

#10 layers of brushes
for i in range(2):
    x = i%2
    print(x)
    offset = (.5*x)
    hair_layer(offset)
    brush_support(2)
    t.extrude(-1)

# three layers of support after brushes
brush_support(3)

turtle = t.draw_turtle()


#####################################################


lines = []
for l in t.line_segs:
    lines.append(rs.AddLine(l[0], l[1]))

extrusion = []
i = 0
for e in t.extrusion_history:
    if (i>0):
        distance = rs.CurveLength(lines[i])
        density = e/distance
        extrusion.append(density*3)
    i=i+1

t.finish()
# ---------- end python_2 ----------
line = Line(python_2.lines)
srf = Surface(python_2.turtle)
pipe = Pipe(Curve=line, Radius=python_2.extrusion, Caps=0)
