# Grasshopper definition simple_polygon_with_bottom.gh (Grasshopper 1.0.7)

python = GhPythonScript()  # -> out, file
# ---------- python: Python ----------
import rhinoscriptsyntax as rs

filter = "GCode (*.gcode)|*.gcode|All Files (*.*)|*.*||"
file = rs.SaveFileName("", filter)
# ---------- end python ----------
python_2 = GhPythonScript(file=python.file)  # -> out, lines, extrusion, turtle
# ---------- python_2: Python ----------
# code required so that library reloads appropriately
# must be above other import statements
import sys
to_delete = list()
for module in sys.modules:
   if "extruder_turtle" in module:
      to_delete.append(module)  

for module in to_delete:
    sys.modules.pop(module)
    
import rhinoscriptsyntax as rs
import numbers
import extruder_turtle
from extruder_turtle import *
import math
import random

reload(extruder_turtle)

#potter bot parameters
layer_height = 3
extrude_rate = 3
extrude_width = 5

t = ExtruderTurtle()
t.use_degrees = True

## Set up the turtle
t.setup(x=90, y=10, z=0, filename=file)
t.set_density(extrude_rate)

def polygon (size, number_sides):
    for j in range(number_sides):
        t.forward(size)
        t.left(360/number_sides)
    
def polygon_prism (size, number_sides, height):
    for i in range(int(height/layer_height)):
        polygon(size, number_sides)
        t.lift(layer_height)
        
def polygon_layer (size, number_sides):
    x = t.getX()
    y = t.getY()
    r = size/(2*math.sin(math.radians(180/number_sides)))
    number_polygons = int(r/(extrude_width*2))
    dr = r/number_polygons
    outer_angle = 360/number_sides
    inner_angle = 180-360/number_sides
    r1 = dr
    # move to center polygon
    t.right(outer_angle+inner_angle/2)
    t.backward(r-dr)
    t.left(outer_angle+inner_angle/2)
    while r1 < r:
        side_length = r1 * (2*math.sin(math.radians(180/number_sides)))
        polygon(side_length, number_sides)
        t.right(outer_angle+inner_angle/2)
        t.forward(dr)
        t.left(outer_angle+inner_angle/2)
        r1 += dr
    polygon(size,number_sides)

for i in range(3):
    polygon_layer(100,7)
    t.lift(layer_height*.8)

polygon_prism(100,7,50)


#####################################################


lines = []
for l in t.line_segs:
    lines.append(rs.AddLine(l[0], l[1]))

extrusion = []
i = 0
for e in t.extrusion_history:
    if (i>0):
        distance = rs.CurveLength(lines[i])
        density = e/distance
        extrusion.append(extrude_width)
    i=i+1

t.finish()
# ---------- end python_2 ----------
line = Line(python_2.lines)
srf = Surface(python_2.turtle)
pipe = Pipe(Curve=line, Radius=python_2.extrusion, Caps=0)
