# Grasshopper definition string_art.gh (Grasshopper 1.0.7)

python = GhPythonScript()  # -> out, file
# ---------- python: Python ----------
import rhinoscriptsyntax as rs

filter = "GCode (*.gcode)|*.gcode|All Files (*.*)|*.*||"
file = rs.SaveFileName("", filter)
# ---------- end python ----------
python_2 = GhPythonScript(file=python.file)  # -> out, lines, extrusion, turtle
# ---------- python_2: Python ----------
# code required so that library reloads appropriately
# must be above other import statements
import sys
to_delete = list()
for module in sys.modules:
   if "extruder_turtle" in module:
      to_delete.append(module)  

for module in to_delete:
    sys.modules.pop(module)
    
import rhinoscriptsyntax as rs
import numbers
import extruder_turtle
from extruder_turtle import *
import math
import random

reload(extruder_turtle)

t = ExtruderTurtle()
t.use_degrees = True

## Set up the turtle
t.setup(x=100, y=100, z=0, filename=file)

def string0():
    for i in range(int(size/(dx*2))):
        previousX = t.getX()
        previousY = t.getY()
        nextX = startingX + size
        nextY = startingY + dy*(i*2+1)
        t.set_position(nextX, nextY)
        t.left(90)
        t.forward(dy)
        t.lift(.01)
        t.set_position(previousX+dx, previousY)
        t.right(90)
        t.forward(dx)
        t.lift(.01)

def corner(layers, size):
    for i in range (int(layers/2)):
        t.forward(size)
        t.left(90)
        t.forward(size)
        t.lift(.2)
        t.backward(size)
        t.right(90)
        t.backward(size)
        t.lift(.2)

def string1(size, dx, vspacing):
    dy = dx
    startingX = t.getX()
    startingY = t.getY()
    for i in range(1,int(size/dx)):
        t.forward(dx*i)
        farX = startingX + size
        nextY = startingY + dy*i
        print(nextY)
        t.set_position(farX, nextY)
        t.penup()
        t.set_position(startingX,startingY)
        t.pendown()
        corner(vspacing,size)

size = 60
dx = 2
t.set_density(.05)
t.rate(1000)

corner(6,size)
string1(size,dx,6)

t.rate(300)
#t.set_density(.2)

turtle = t.draw_turtle()


t.penup()
t.backward(size)
t.pendown()


#####################################################


lines = []
for l in t.line_segs:
    lines.append(rs.AddLine(l[0], l[1]))

t.finish()
# ---------- end python_2 ----------
line = Line(python_2.lines)
srf = Surface(python_2.turtle)
pipe = Pipe(Curve=line, Radius=python_2.extrusion, Caps=0)
