# Grasshopper definition turtletest.gh (Grasshopper 1.0.7)

python = GhPythonScript()  # -> out, file
# ---------- python: Python ----------
import rhinoscriptsyntax as rs

filter = "GCode (*.gcode)|*.gcode|All Files (*.*)|*.*||"
file = rs.SaveFileName("", filter)
# ---------- end python ----------
python_2 = GhPythonScript(file=python.file, density=Slider(0.2, range=0..1))  # -> out, lines, extrusion, point
# ---------- python_2: Python ----------
# code required so that library reloads appropriately
# must be above other import statements
import sys
to_delete = list()
for module in sys.modules:
   if "extruder_turtle" in module:
      to_delete.append(module)  

for module in to_delete:
    sys.modules.pop(module)
    
import rhinoscriptsyntax as rs
import numbers
import extruder_turtle
from extruder_turtle import *
import math

reload(extruder_turtle)


## Set up the turtle
t = ExtruderTurtle()
t.track_history = True
t.use_degrees = True
t.name(file)
t.setup(x=55, y=125, z=.2)

def fast_square (layers, size):
    t.rate(2000)
    for i in range(layers):
        for j in range(4):
            t.forward(size)
            t.right(90)
        t.lift(.2)
    
default_density = .03
default_speed = 2000


def test_and_move (speed):
    t.set_density(default_density)
    size = 50
    t.right(90)
    fast_square(10,size)

    t.rate(speed)
    for i in range(10):
        t.set_density(.01*(i+1))
        t.forward(size/21)
        t.right(90)
        t.forward(size)
        t.left(90)
        t.forward(size/21)
        t.left(90)
        t.forward(size)
        t.right(90)
    t.rate(default_speed)
    t.forward(size/21)
    t.right(90)

    fast_square(2,size)

    t.penup()
    t.lift(10)
    t.right(90)
    t.forward(size)
    t.right(90)
    t.forward(size+5)
    t.lift(-t.getZ())
    t.lift(.2)
    t.pendown()


test_and_move(2000)
test_and_move(1500)
test_and_move(1000)
test_and_move(500)

point = rs.CreatePoint(t.getX(), t.getY(), t.getZ())
print point
print t.get_yaw()



#######################################
#######################################
#######################################
#######################################
lines = []
for l in t.line_segs:
    lines.append(rs.AddLine(l[0], l[1]))

extrusion = []
i = 0
for e in t.extrusion_history:
    if (i>0):
        distance = rs.CurveLength(lines[i])
        density = e/distance
        if (density == 0):
            density = (t.extrusion_history[i-1])/rs.CurveLength(lines[i-1])
        extrusion.append(density)
    i=i+1

t.finish()
# ---------- end python_2 ----------
panel = Panel(python_2.point)
line = Line(python_2.lines)
pipe = Pipe(Curve=line, Radius=python_2.extrusion, Caps=0)
pt = Point(python_2.point)
sph = Sphere(Base=pt, Radius=Slider(2.9, range=0..20))
