# Grasshopper definition zigzag.gh (Grasshopper 1.0.7)

python = GhPythonScript()  # -> out, file
# ---------- python: Python ----------
import rhinoscriptsyntax as rs

filter = "GCode (*.gcode)|*.gcode|All Files (*.*)|*.*||"
file = rs.SaveFileName("", filter)
# ---------- end python ----------
python_2 = GhPythonScript(file=python.file, density=Slider(0.2, range=0..1))  # -> out, lines, extrusion
# ---------- python_2: Python ----------
# code required so that library reloads appropriately
# must be above other import statements
import sys
to_delete = list()
for module in sys.modules:
   if "extruder_turtle" in module:
      to_delete.append(module)  

for module in to_delete:
    sys.modules.pop(module)
    
import rhinoscriptsyntax as rs
import numbers
import extruder_turtle
from extruder_turtle import *
import math

reload(extruder_turtle)

t = ExtruderTurtle()
t.track_history = True
t.use_degrees = True

## Set up the turtle
t.name(file)
t.setup(x=50, y=50, z=0)
t.rate(1000)
t.lift(.2)
angle = 90
step_size = 10

def forwardMesh(distance):
    i = 0
    while (i<distance/2):
        t.forward(2)
        t.penup()
        t.left(90)
        t.forward(1)
        t.dwell(50)
        t.forward(-2)
        t.dwell(50)
        t.forward(1)
        t.right(90)
        t.pendown()
        i = i+1
        
    
for z in range(10):
    for i in range(5):
        t.left(angle)
        t.forward(step_size)
        t.right(angle)
        t.forward(step_size)
    t.right(180)
    t.lift(.2)


#####################################################

lines = []
for l in t.line_segs:
    lines.append(rs.AddLine(l[0], l[1]))

extrusion = []
i = 0
for e in t.extrusion_history:
    if (i>0):
        distance = rs.CurveLength(lines[i])
        density = e/distance
        extrusion.append(density/2)
    i=i+1

t.finish()
# ---------- end python_2 ----------
line = Line(python_2.lines)
pipe = Pipe(Curve=line, Radius=python_2.extrusion, Caps=0)
