# Grasshopper definition turtletest.gh (Grasshopper 1.0.7)

python = GhPythonScript()  # -> out, file
# ---------- python: Python ----------
__author__ = "franklindyer"

import rhinoscriptsyntax as rs

filter = "GCode (*.gcode)|*.gcode|All Files (*.*)|*.*||"
file = rs.SaveFileName("", filter)
# ---------- end python ----------
python_2 = GhPythonScript(file=python.file)  # -> out, lines
# ---------- python_2: Python ----------
__author__ = "franklindyer"

import rhinoscriptsyntax as rs
import sys
import numbers
from extruder_turtle import *
import math

t = ExtruderTurtle()
t.track_history = True
## t.write_gcode = False

## Set up the turtle
t.name(file)
t.setup(x=0, y=0)
t.rate(700)

for l in range(30):
    ## Draw a seven-pointed star
    for k in range(7):
        t.forward(50)
        t.right(6*math.pi/7)

    ## Move to the next layer
    t.lift(0.3)
    
t.set_heading(math.pi/2, math.pi/2, 0)
t.forward(100)


lines = []
for l in t.line_segs:
    lines.append(rs.AddLine(l[0], l[1]))
# ---------- end python_2 ----------
line = Line(python_2.lines)
